vi "main.gviweb"   [LabVIEW NXG 3.1.0]
panel controls:
  "Tab": i32
panel indicators:
  "Background Image": string
  "Background Image 2": string
diagram:
  Property Node(instance in=reference to "Tab", "Position"=cluster{"Left": f32, "Top": f32} {"Left"=0, "Top"=-25})
  Property Node(instance in=reference to "Background Image", "Position"=cluster{"Left": f32, "Top": f32} {all zero or empty})
  Property Node(instance in=reference to "Background Image 2", "Position"=cluster{"Left": f32, "Top": f32} {all zero or empty})
